# Grasshopper definition test_json.gh (Grasshopper 1.0.7)
# plug-ins: jSwan

bnd_json = FilePath("C:\Users\BT\Documents\GitHub\bndreader\BND.json")
deserialize_json = DeserializeJson(JSON=bnd_json, OutputsLocked=False)  # -> ProgramVersion, Nodes, SuspiciousNodes, BranchLists, SupplyAirPaths, ReturnAirPaths, OutdoorAirNodes, ComponentSets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
panel = Panel(deserialize_json.ProgramVersion)
deserialize_json_2 = DeserializeJson(JSON=deserialize_json.ComponentSets, OutputsLocked=False)
deserialize_json_3 = DeserializeJson(JSON=deserialize_json.AirLoopHVACs, OutputsLocked=False)  # -> AirLoopHVAC, AirLoopReturnConnections, AirLoopSupplyConnections, CooledZoneInfo, HeatedZoneInfo, OutdoorAirConnections, AirLoopHVACConnector, AirLoopHVACConnectorBranches, AirLoopHVACConnectorNodes
deserialize_json_4 = DeserializeJson(JSON=deserialize_json_2, OutputsLocked=False)  # -> ComponentSetCount, ParentObjectType, ParentObjectName, ComponentType, ComponentName, InletNodeID, OutletNodeID, Description
deserialize_json_5 = DeserializeJson(JSON=deserialize_json_3.AirLoopHVAC, OutputsLocked=False)  # -> AirLoopName, ReturnNodes, SupplyNodes, ZonesCooled, ZonesHeated, OutdoorAirUsed
panel_2 = Panel(deserialize_json_4.ComponentName)
